# Grasshopper definition SolarGAN_Hops_Template.gh (Grasshopper 1.0.7)
# plug-ins: Hops, SolarGAN

path = FilePath("C:\Radiance\bin\")
brep = Brep(<brep referenced from the Rhino model>)
pt = Point(<point referenced from the Rhino model>)
srf = Surface([<surface referenced from the Rhino model> x6])
brep_2 = Brep(<brep referenced from the Rhino model>)
debrep = DeconstructBrep(Brep=brep)  # -> Faces, Edges, Vertices
brep_cp = BrepClosestPoint(Point=pt, Brep=brep_2)  # -> Point, Normal, Distance
radiancegeometryexporter = RadianceGeometryExporter(
    RadianceBinFolderLocation=path,
    BuildingBrepCollection=debrep.Faces,
    WindowsCollection=srf,
    CameraPosition=pt,
    CameraDirection=brep_cp.Normal)  # -> VertexCollection, OutputPath, ExePath
image_resource = ImageResource(radiancegeometryexporter.OutputPath)
panel = Panel(radiancegeometryexporter.ExePath)
number_slider = Slider(1, range=0..100)
flatten = FlattenTree(Tree=radiancegeometryexporter.OutputPath, Path="{0}")
range = Range(Domain="[-3.14,3.14]", Steps=Slider(52, range=0..100))
range_2 = Range(Domain="[-1,1]", Steps=Slider(26, range=0..100))
split = SplitList(List=range, Index=Slider(1, range=0..1))  # -> ListA, ListB
hops = Hops(
    InputPath=flatten,
    CacheResultsInMemory=False,
    CacheSolveResults=False,
    RemoteDefinitionLocation="http://127.0.0.1:5000/image_processing",
    RemoteSolveVersion=(0, 1, 0),
    ShowInput_Enabled=False,
    ShowInput_Path=False,
    SynchronousSolve=True)  # -> OutputPath1, OutputPath2
rev = ReverseList(List=range_2)
pt2num = PointsToNumbers(Points=brep_cp.Normal, Mask=4)
pt2num_2 = PointsToNumbers(Points=brep_cp.Point, Mask=4)
shift = ShiftList(List=split.ListB, Shift=Slider(13, range=0..100), Wrap=True)
split_2 = SplitList(List=range_2, Index=number_slider)  # -> ListA, ListB
split_3 = SplitList(List=rev, Index=number_slider)  # -> ListA, ListB
image_resource_2 = ImageResource(hops.OutputPath1)
sin = Sine(Value=shift)
flatten_2 = FlattenTree(Tree=split_2.ListB, Path="{0}")
flatten_3 = FlattenTree(Tree=split_3.ListB, Path="{0}")
item = ListItem(List=pt2num_2, Index="2", Wrap=True)
item_2 = ListItem(List=pt2num, Index="1", Wrap=True)
item_3 = ListItem(List=pt2num, Index="0", Wrap=True)
flatten_4 = FlattenTree(Tree=sin, Path="{0}")
merge = Merge(Data1=flatten_2, Data2=flatten_3)
flatten_5 = FlattenTree(Tree=item, Path="{0}")
flatten_6 = FlattenTree(Tree=item_3, Path="{0}")
flatten_7 = FlattenTree(Tree=item_2, Path="{0}")
hops_2 = Hops(
    Path=hops.OutputPath1,
    CacheResultsInMemory=False,
    CacheSolveResults=False,
    RemoteDefinitionLocation="http://127.0.0.1:5000/att_processing",
    RemoteSolveVersion=(0, 1, 0),
    ShowInput_Enabled=False,
    ShowInput_Path=False,
    SynchronousSolve=True)  # -> C_mu, C_var
graph = QuickGraph(flatten_4, SortOrder=0)
graph_2 = QuickGraph(merge, SortOrder=0)
panel_2 = Panel(flatten_7)
panel_3 = Panel(flatten_6)
panel_4 = Panel(flatten_5)
button = Button()
path_2 = FilePath("C:\Users\phili\Documents\GitHub\hive\GrasshopperExamples\Templates\HIVE_Zurich.epw")
hops_3 = Hops(
    Run=Toggle(True),
    EnsembleSize=Slider(100, range=0..100),
    ImageFeatures=hops_2.C_mu,
    Latitude=Slider(46.25, range=0..90),
    Longitude=Slider(6.13, range=0..180),
    Height=panel_4,
    SurfaceNormalX=panel_3,
    SurfaceNormalY=panel_2,
    SolarDeclination=merge,
    EPWFilePath=path_2,
    CacheResultsInMemory=False,
    CacheSolveResults=False,
    RemoteDefinitionLocation="http://127.0.0.1:5000/timeseries_gen",
    RemoteSolveVersion=(0, 1, 0),
    ShowInput_Enabled=False,
    ShowInput_Path=False,
    SynchronousSolve=True)  # -> TimeSeries, DNIWeeklyAverage, DNIWeeklyPeak, DHIWeeklyAverage, DHIWeeklyPeak, DNIWeeklyMaxAvg, DNIWeeklyMinAvg, DHIWeeklyMaxAvg, DHIWeeklyMinAvg
split_4 = SplitList(List=hops_3.TimeSeries, Index=Slider(168, range=0..1000))  # -> ListA, ListB
graph_3 = QuickGraph(hops_3.DHIWeeklyMaxAvg, SortOrder=0)
graph_4 = QuickGraph(hops_3.DNIWeeklyMaxAvg, SortOrder=0)
graph_5 = QuickGraph(hops_3.TimeSeries, SortOrder=0)
graph_6 = QuickGraph(hops_3.DNIWeeklyAverage, SortOrder=0)
graph_7 = QuickGraph(hops_3.DHIWeeklyAverage, SortOrder=0)
graph_8 = QuickGraph(hops_3.DNIWeeklyMinAvg, SortOrder=0)
graph_9 = QuickGraph(hops_3.DHIWeeklyMinAvg, SortOrder=0)
graph_10 = QuickGraph(hops_3.DNIWeeklyPeak, SortOrder=0)
graph_11 = QuickGraph(hops_3.DHIWeeklyPeak, SortOrder=0)
# 30: Glazing ratio
# 16: near far
# 12: up down
number_slider_2 = Slider(0, range=-5..5)
hops_4 = Hops(
    C_mu=hops_2.C_mu,
    C_dim=Slider(17, range=0..100),
    Value=number_slider_2,
    CacheResultsInMemory=False,
    CacheSolveResults=False,
    RemoteDefinitionLocation="http://127.0.0.1:5000/wwr_traversal",
    RemoteSolveVersion=(0, 1, 0),
    ShowInput_Enabled=False,
    ShowInput_Path=False,
    SynchronousSolve=True)
image_resource_3 = ImageResource(hops_4)
